% Simulink data dictionary ACC.sldd

AEB_Intervention_Active = Simulink.Signal(DataType="boolean")
Acc_pedal_Pos = Simulink.Signal(DataType="uint8")
ACC_Master_Switch = Simulink.Signal(DataType="Enum: Dt_Enum_ACC_Master_Switch_E")
CAN_Bus_Error = Simulink.Signal(DataType="boolean")
Driver_Door_open = Simulink.Signal(DataType="boolean")
Electronic_Parking_Brake_Failure = Simulink.Signal(DataType="boolean")
Engine_Torque_Unavailable = Simulink.Signal(DataType="boolean")
Fusion_Confidence = Simulink.Signal(DataType="uint8")
Ignition_Status = Simulink.Signal(DataType="Enum: Dt_Enum_Ignition_Status_E")
Lane_Width = Simulink.Signal(DataType="uint16", Unit="cm")
POST_Status = Simulink.Signal(DataType="Enum: Dt_Enum_POST_Status_E")
Pedal_Sensor_Signal_Plausibility_Error = Simulink.Signal(DataType="boolean")
Radar_Signal_Blocked = Simulink.Signal(DataType="boolean")
Target_Detected = Simulink.Signal(DataType="boolean")
Seatbelt_Unlocked = Simulink.Signal(DataType="boolean")
Sensor_Alignment_Lost = Simulink.Signal(DataType="boolean")
Target_Lateral_Offset = Simulink.Signal(DataType="uint16", Unit="cm")
Audible_Warning = Simulink.Signal(DataType="Enum: Dt_Enum_Audible_Warning_E")
Internal_Control_Mode = Simulink.Signal(DataType="Enum: Dt_Enum_Internal_Control_Mode_E")
HMI_ACC_ICON = Simulink.Signal(DataType="Enum: Dt_Enum_HMI_ACC_ICON_E")
Torque_Request_Status = Simulink.Signal(DataType="Enum: Dt_Enum_Torque_Request_Status_E")
Button_Status = Simulink.Signal(DataType="Enum: Dt_Enum_Button_Status_E")
Brake_Pedal = Simulink.Signal(DataType="Enum: Dt_Enum_Brk_Pedal_E")
V_Lead = Simulink.Signal(DataType="uint8", Unit="km/h")
V_ego = Simulink.Signal(DataType="uint8", Unit="km/h")
HMI_SetSpeed = Simulink.Signal(DataType="uint8", Unit="km/h")
HMI_Distance = Simulink.Signal(DataType="uint16")
Standstill_Dist = Simulink.Signal(DataType="uint16")
Acceleration_request = Simulink.Signal(DataType="single")

Dt_Enum_HMI_ACC_ICON_E = enum(DefaultValue="Off", StorageType="uint8", AddClassNameToEnumNames=true)
  Off = 0
  White = 1
  Green = 2
  Blink_Green = 3
  Red = 4

Dt_Enum_Internal_Control_Mode_E = enum(DefaultValue="Standstill", StorageType="uint8", AddClassNameToEnumNames=true)
  Standstill = 0
  Monitoring = 1
  Speedctrl = 2
  Distctrl = 3
  Passive = 4
  Error = 5

Dt_Enum_Torque_Request_Status_E = enum(DefaultValue="Disabled", StorageType="uint8", AddClassNameToEnumNames=true)
  Disabled = 0
  Standby = 1
  Longi = 2
  Dis_active = 3
  Hold_Req = 4
  Override = 5
  Fault = 6

Dt_Enum_ACC_State_E = enum(DefaultValue="ACC_Off", StorageType="uint8", AddClassNameToEnumNames=true)
  ACC_Off = 0
  ACC_Standby = 1
  ACC_Fault = 2
  ACC_Active = 3
  ACC_Active_Follow = 4
  ACC_Stop_Hold = 5
  ACC_Override = 6

Dt_Enum_ACC_Master_Switch_E = enum(DefaultValue="Switch_Off", StorageType="uint8", AddClassNameToEnumNames=true)
  Switch_Off = 0
  Switch_On = 1

Dt_Enum_Audible_Warning_E = enum(DefaultValue="Warn_None", StorageType="uint8", AddClassNameToEnumNames=true)
  Warn_None = 0
  Warn_Single_Beep = 1
  Warn_Chime = 2
  Warn_Loud_Chime = 3

Dt_Enum_POST_Status_E = enum(DefaultValue="Failed", StorageType="uint8", AddClassNameToEnumNames=true)
  Failed = 0
  Success = 1

Dt_Enum_Brk_Pedal_E = enum(DefaultValue="Pedal_Released", StorageType="uint8", AddClassNameToEnumNames=true)
  Pedal_Released = 0
  Pedal_Pressed = 1

Dt_Enum_Button_Status_E = enum(DefaultValue="None", StorageType="uint8", AddClassNameToEnumNames=true)
  None = 0
  Set = 1
  Cancel = 2
  Resume = 3

Dist_Rel = Simulink.Signal(DataType="single")
Safety_Time_Gap = Simulink.Signal(DataType="single", Unit="s")
Measured_Distance = Simulink.Signal(DataType="single")

Dt_Enum_Ignition_Status_E = enum(DefaultValue="Ign_Off", StorageType="uint8", AddClassNameToEnumNames=true)
  Ign_Off = 0
  Ign_ACC = 1
  Ign_Run = 2